# Grasshopper definition gHowl_UDP_send+receive.ghx (Grasshopper 0.9.75)
# plug-ins: Anemone, gHowl

# GH components:
# gHowl UDP protocol
# Anemone Loops
port = Panel("7001")
# GH components:
# gHowl UDP protocol
# Anemone Loops
# Import string from Processing
udp_owl = UDPReceiver(Port=port, Pattern=0)  # -> Info, Data
panel = Panel(udp_owl.Data)
# Parse string into small text chunks
split = StringSplit(String=udp_owl.Data, Separators=";")
loop_start = LoopStart(Repeat=0, Data_0=split)  # -> port, Counter, Data_0
panel_2 = Panel(loop_start.Data_0)
# Split into groups of 4 numbers
# that define the geometry
partition = PartitionList(List=loop_start.Data_0, Size="4")
panel_3 = Panel(partition)
# Split into groups of 2 numbers
# that define the origin and size & draw box
loop_start_2 = LoopStart(Repeat=0, Data_0=partition)  # -> port, Counter, Data_0
# for rect (x,y,w,h)
# where x,y is origin
# w,h is size
# want random heights - but input into Box.z doesn't get called correctly.
# thinking the random values will need to be generated and then inserted?
# * add the value in processing
split_2 = SplitList(List=loop_start_2.Data_0, Index=2)  # -> ListA, ListB
split_3 = SplitList(List=split_2.ListA, Index=1)  # -> ListA, ListB
pt = ConstructPoint(XCoordinate=split_3.ListA, YCoordinate=split_3.ListB, ZCoordinate=0)
split_1 = SplitList(List=split_2.ListB, Index=1)  # -> ListA, ListB
# try either domain box
# or center box!
box = DomainBox(Base=pt, X=split_1.ListA, Y=split_1.ListB, Z=Domain(0, 25))
loop_end = LoopEnd(port=loop_start_2.port, Exit=False, Data_0=box, pausedState=False, state="Last & Record")
loop_end_2 = LoopEnd(port=loop_start.port, Exit=False, Data_0=loop_end, pausedState=False, state="Last & Record")
panel_4 = Panel(loop_end_2)
